# Requirement set guidance (R2021b)

## 1 [GUID-FUNC]

### 1.1 [GUID-FUNC-1] The system shall know the active leg at all times

### 1.2 [GUID-FUNC-2] The system shall compute transitions and follow the progress of the active leg

### 1.3 [GUID-FUNC-3] The system shall compiute the distance between the aircraft's current position and the active waypoint.